# Grasshopper definition sectiondrawer.gh (Grasshopper 0.9.76)
# plug-ins: Python Interpreter

reversesection = BooleanToggle(True)
reset = Button()
redo = Button()
marksize = Slider(6, range=0..100)
nextsection = Button()

# ---- group: 切断線
crv = Curve(reparameterize(<curve referenced from the Rhino model>))

# ----
curvepoint = PointOnCurve(crv, parameter=0.5)
sort_pt = SortPoints(Points=curvepoint)  # -> Points, Indices
item = ListItem(List=crv, Index=sort_pt.Indices, Wrap=True)
crv_2 = Curve(item)
lng = ListLength(List=crv_2)
file = ReadFile(File="D:\python\sectiondrawer\1116\sectiondrawer\sectiondrawer.py", PerLineParse=False)
end = EndPoints(Curve=crv_2)  # -> Start, End
series = Series(Start=0, Step=1, Count=lng)
merge = Merge(Data1=graft(end.Start), Data2=graft(end.End))
int = Integer(series)
python = PythonScript(
    curve=crv_2,
    reverse=reversesection,
    directory="D:\\test\",
    name="name",
    reset=reset,
    next=nextsection,
    redo=redo,
    mark=marksize)  # -> out, preview; inputs curve: list
# ---------- python: Python ----------
#coding utf-8
import rhinoscriptsyntax as rs
import scriptcontext as sc
import Rhino

if "count_section" not in sc.sticky:
	sc.sticky["count_section"] = 0
if "dict_section" not in sc.sticky:
	sc.sticky["dict_section"] = {}

def Reset():
	sc.sticky["count_section"] = 0
	sc.sticky["dict_section"] = {}
	rs.Command("_CPlane " + "_W " + "_T ")
	rs.Command("_Setview " + "_W " + "_P ")
	Rhino.RhinoApp.Exit()
if reset:
	Reset()

pt_0 = rs.CurveStartPoint(curve[sc.sticky["count_section"]])
pt_1 = rs.CurveEndPoint(curve[sc.sticky["count_section"]])
if reverse:
	startpt = pt_0
	endpt = pt_1
else:
	startpt = pt_1
	endpt = pt_0
vec_x = rs.VectorCreate(startpt, endpt)
vec_y = rs.VectorUnitize(rs.VectorCrossProduct(vec_x, [0,0,1])) * mark
movedpt = [rs.MoveObject(rs.AddPoint([pt[0], pt[1], pt[2]]), vec_y) for pt in [startpt, endpt]]
preview = [rs.AddLine(movedpt[0], startpt)] + [rs.AddLine(movedpt[1], endpt)]

height = rs.AddPoint(startpt[0], startpt[1], startpt[2] + 1000)
sc.sticky["dict_section"][sc.sticky["count_section"]] = [str(startpt), str(endpt), str(rs.coerce3dpoint(height))]
print(sc.sticky["dict_section"][sc.sticky["count_section"]][0])

#///////////////////////////ボタン入力したあとの動作
draw = False
if next:
	if len(sc.sticky["dict_section"]) == len(curve):
		draw = True
	else:
		sc.sticky["count_section"] += 1

if redo:
	if sc.sticky["count_section"] == 0:
		pass
	else:
		del sc.sticky["dict_section"][sc.sticky["count_section"]]
		sc.sticky["count_section"] -= 1

if draw:
	print("startdrawing")
	count = 0
	rs.EnableRedraw(False)
	while count != len(sc.sticky["dict_section"]):
		rs.Command("_Selall")
		rs.Command("_Clippingplane " + "_p " + sc.sticky["dict_section"][count][0] + " " + sc.sticky["dict_section"][count][1] + " " + sc.sticky["dict_section"][count][2] + " ")
		rs.Command("_CPlane " + "_I " + sc.sticky["dict_section"][count][0] + " " + sc.sticky["dict_section"][count][1] + " " + sc.sticky["dict_section"][count][2] + " ")
		rs.Command("_Plan")
		rs.Command("-_Make2d " + "_D " + "_C " + "_Enter ")
		rs.Command("_CPlane " + "_W " + "_T ")
		rs.Command("-_Export " + directory + name + str(count) + ".3dm")
		rs.Command("_Delete")
		rs.Command("_SelClippingPlane")
		rs.Command("_Delete")
		count += 1
	rs.EnableRedraw(True)
	Reset()
# ---------- end python ----------
panel = Panel(python.out)
tag = TextTag3D(Location=merge, Text=graft(int), Size=Slider(1, range=0..10), Justification=7)
